# Dynamo graph Mining Program Data.dyn (Dynamo 2.3.0.5885)
# packages: Data-Shapes 2019.2.42

# group: Logo File Path
file_path = Filename("..\Assets\MidwestUniversityLogo.jpg")

# group: Getting Phases
getting_phases = Python()
# ---------- getting_phases.python (67 lines) ----------
# Enable Python support and load DesignScript library
import clr
clr.AddReference('ProtoGeometry')
from Autodesk.DesignScript.Geometry import *

clr.AddReference('RevitNodes')
import Revit
clr.ImportExtensions(Revit.Elements)

clr.ImportExtensions(Revit.GeometryConversion)

clr.AddReference('RevitServices')
import RevitServices
from RevitServices.Persistence import DocumentManager
from RevitServices.Transactions import TransactionManager
from System.Collections.Generic import *

clr.AddReference('RevitAPI')
import Autodesk
from Autodesk.Revit.DB import *

clr.AddReference('DSCoreNodes')
import DSCore
from DSCore.List import *

def uniqueVals(_listInput):
	_listOut = [_listInput[0]]
	for i,_item in enumerate(_listInput):
		if i > 0:
			unique = True
			for _comparison in _listOut:
				if _comparison == _item:
					unique = False
					break
			if unique:
				_listOut.append(_item)
	return _listOut


doc = DocumentManager.Instance.CurrentDBDocument
uiapp = DocumentManager.Instance.CurrentUIApplication
app = uiapp.Application
uidoc = DocumentManager.Instance.CurrentUIApplication.ActiveUIDocument

phaseNames = []
phaseIds = []
for phase in doc.Phases:
	phaseNames.append(phase.Name)
	phaseIds.append(phase.Id)

rooms = FilteredElementCollector(doc).OfCategory(BuiltInCategory.OST_Rooms).WhereElementIsNotElementType().ToElements()

roomsInPhase = []
roomPhases = []
for room in rooms:
	roomPhases.append(room.get_Parameter(BuiltInParameter.ROOM_PHASE).AsValueString())

for phase in phaseNames:
	roomCounter = 0
	for roomPhase in roomPhases:
		if phase == roomPhase:
			roomCounter += 1
	roomsInPhase.append(roomCounter)
		


OUT = [phaseNames,roomsInPhase]
# ----------------------------------------
code_block = CodeBlock(OUT=getting_phases) { allPhases = OUT[0]; countOfRoomsPerPhase = OUT[1]; }

# group: Bar Chart of Phases Room Counts
code_block_2 = CodeBlock { chartName = "phase distribution of rooms"; seriesName = "rooms"; xAxisTitle = "phases"; yAxisTitle = "count of rooms"; }
code_block_3 = CodeBlock { 254; 195; 41; }
byARGB = Color.ByARGB(r=code_block_3.out0, g=code_block_3.out1, b=code_block_3.out2)
barChart = Custom[UI.BarChart](Chart_name=code_block_2.chartName, Series_names=code_block_2.seriesName, X_values=code_block.allPhases, Y_values=code_block.countOfRoomsPerPhase, Chart_colors_optionnal=byARGB, X_Axis_Label_optionnal=code_block_2.xAxisTitle, Y_Axis_Label_optionnal=code_block_2.yAxisTitle)  # package Data-Shapes; BarChart

# group: Phase Selection
code_block_4 = CodeBlock { listViewName = "select phases"; listViewHeight = 400; alphabetical = false; }
ui_listview_data = Custom[UI.Listview Data](InputName=code_block_4.listViewName, Keys=code_block.allPhases, Values=code_block.allPhases, Height_optionnal=code_block_4.listViewHeight, SortItems_optionnal=code_block_4.alphabetical)  # package Data-Shapes; Create data for ListView input in UI.MultiInputForm ++ . Check out www.data-shapes.net for more infos.

# group: Phase Filter Interface
code_block_5 = CodeBlock { description = "Phase Selection"; buttonText = "Select Phases"; }
list_create = List.Create(item0=barChart, item1=ui_listview_data)
boolean = BoolSelector(true)
code_block_6 = CodeBlock { cancelButton = "STOP"; maxHeight = 1000; interfaceWidth = 600; }
ui_multipleinputform = Custom[UI.MultipleInputForm ++](Description_optional=code_block_5.description, Logo_optional=file_path, ButtonText_optional=code_block_5.buttonText, Inputs=list_create, Toggle=boolean, CancelButtonText_optional=code_block_6.cancelButton, MaxHeight_optional=code_block_6.maxHeight, Width_optional=code_block_6.interfaceWidth)  # package Data-Shapes; Create a form with multiple inputs. see www.data-shapes.net for tutorials and infos!
flatten = List.Flatten(list=ui_multipleinputform.User_Inputs)

# group: Filtering By Phase and Getting Depts
filtering_rooms_by_phases_and = Python(IN[0]=flatten)  # "Filtering Rooms by Phases and Finding Departments"
# ---------- filtering_rooms_by_phases_and.python (71 lines) ----------
# Enable Python support and load DesignScript library
import clr
clr.AddReference('ProtoGeometry')
from Autodesk.DesignScript.Geometry import *

clr.AddReference('RevitNodes')
import Revit
clr.ImportExtensions(Revit.Elements)

clr.ImportExtensions(Revit.GeometryConversion)

clr.AddReference('RevitServices')
import RevitServices
from RevitServices.Persistence import DocumentManager
from RevitServices.Transactions import TransactionManager
from System.Collections.Generic import *

clr.AddReference('RevitAPI')
import Autodesk
from Autodesk.Revit.DB import *

clr.AddReference('DSCoreNodes')
import DSCore
from DSCore.List import *

def uniqueVals(_listInput):
	_listOut = [_listInput[0]]
	for i,_item in enumerate(_listInput):
		if i > 0:
			unique = True
			for _comparison in _listOut:
				if _comparison == _item:
					unique = False
					break
			if unique:
				_listOut.append(_item)
	return _listOut


doc = DocumentManager.Instance.CurrentDBDocument
uiapp = DocumentManager.Instance.CurrentUIApplication
app = uiapp.Application
uidoc = DocumentManager.Instance.CurrentUIApplication.ActiveUIDocument

selectedPhases = IN[0]

if type(selectedPhases) != list:
	selectedPhases = [selectedPhases]

rooms = FilteredElementCollector(doc).OfCategory(BuiltInCategory.OST_Rooms).WhereElementIsNotElementType().ToElements()

filteredDepartments = []
for room in rooms:
	for phase in selectedPhases:
		if room.get_Parameter(BuiltInParameter.ROOM_PHASE).AsValueString() == phase:
			if room.LookupParameter("Department").AsString():
				filteredDepartments.append(room.LookupParameter("Department").AsString())
			else:
				filteredDepartments.append("unnamed")

uniqueDepartments = uniqueVals(filteredDepartments)
departmentCounts = []

for uniqueDept in uniqueDepartments:
	deptCount = 0
	for dept in filteredDepartments:
		if uniqueDept == dept:
			deptCount += 1
	departmentCounts.append(deptCount)

OUT = [uniqueDepartments,departmentCounts]
# ----------------------------------------
code_block_7 = CodeBlock(OUT=filtering_rooms_by_phases_and) { departmentNames = OUT[0]; departmentCounts = OUT[1]; }
normalize_department_names = Python(IN[0]=code_block_7.departmentNames)
# ---------- normalize_department_names.python (20 lines) ----------
namesIn = IN[0]
namesOut = []

def normalizeDepartmentName(_name):
	if _name:
		newName = ''
		for letter in _name:
			if letter == ',':
				letter = ''
			if letter == '&':
				letter = 'and'
			newName += letter
		return newName
	else:
		return ''

for name in namesIn:
	namesOut.append(normalizeDepartmentName(name))

OUT = namesOut
# ----------------------------------------

# group: Bar Chart of Dept Room Counts
code_block_8 = CodeBlock()
# ---------- code_block_8.designscript (4 lines) ----------
chartName = "department distribution of rooms";
seriesName = "rooms";
xAxisTitle = "departments";
yAxisTitle = "count of rooms";
# ----------------------------------------
code_block_9 = CodeBlock { 254; 195; 41; }
byARGB_2 = Color.ByARGB(r=code_block_9.out0, g=code_block_9.out1, b=code_block_9.out2)
barChart_2 = Custom[UI.BarChart](Chart_name=code_block_8.chartName, Series_names=code_block_8.seriesName, X_values=normalize_department_names, Y_values=code_block_7.departmentCounts, Chart_colors_optionnal=byARGB_2, X_Axis_Label_optionnal=code_block_8.xAxisTitle, Y_Axis_Label_optionnal=code_block_8.yAxisTitle)

# group: Department Selection
code_block_10 = CodeBlock { listViewName = "select departments"; listViewHeight = 400; alphabetical = false; }
ui_listview_data_2 = Custom[UI.Listview Data](InputName=code_block_10.listViewName, Keys=normalize_department_names, Values=normalize_department_names, Height_optionnal=code_block_10.listViewHeight, SortItems_optionnal=code_block_10.alphabetical)

# group: Department Filter Interface
code_block_11 = CodeBlock { description = "Department Selection"; buttonText = "Select Departments"; }
list_create_2 = List.Create(item0=barChart_2, item1=ui_listview_data_2)
code_block_12 = CodeBlock { cancelButton = "STOP"; maxHeight = 1000; interfaceWidth = 600; }
ui_multipleinputform_2 = Custom[UI.MultipleInputForm ++](Description_optional=code_block_11.description, Logo_optional=file_path, ButtonText_optional=code_block_11.buttonText, Inputs=list_create_2, Toggle=ui_multipleinputform.Was_Run, CancelButtonText_optional=code_block_12.cancelButton, MaxHeight_optional=code_block_12.maxHeight, Width_optional=code_block_12.interfaceWidth)
flatten_2 = List.Flatten(list=ui_multipleinputform_2.User_Inputs)

# group: Filtering by Phase and Department
finding_room_levels_with_phase = Python(IN[0]=flatten, IN[1]=flatten_2)  # "Finding Room Levels with Phase and Department Filter"
# ---------- finding_room_levels_with_phase.python (99 lines) ----------
# Enable Python support and load DesignScript library
import clr
clr.AddReference('ProtoGeometry')
from Autodesk.DesignScript.Geometry import *

clr.AddReference('RevitNodes')
import Revit
clr.ImportExtensions(Revit.Elements)

clr.ImportExtensions(Revit.GeometryConversion)

clr.AddReference('RevitServices')
import RevitServices
from RevitServices.Persistence import DocumentManager
from RevitServices.Transactions import TransactionManager
from System.Collections.Generic import *

clr.AddReference('RevitAPI')
import Autodesk
from Autodesk.Revit.DB import *

clr.AddReference('DSCoreNodes')
import DSCore
from DSCore.List import *

def uniqueVals(_listInput):
	_listOut = [_listInput[0]]
	for i,_item in enumerate(_listInput):
		if i > 0:
			unique = True
			for _comparison in _listOut:
				if _comparison == _item:
					unique = False
					break
			if unique:
				_listOut.append(_item)
	return _listOut

def normalizeDepartmentName(_name):
	if _name:
		newName = ''
		for letter in _name:
			if letter == ',':
				letter = ''
			if letter == '&':
				letter = 'and'
			newName += letter
		return newName
	else:
		return ''

doc = DocumentManager.Instance.CurrentDBDocument
uiapp = DocumentManager.Instance.CurrentUIApplication
app = uiapp.Application
uidoc = DocumentManager.Instance.CurrentUIApplication.ActiveUIDocument

selectedPhases = IN[0]
selectedDepartments = IN[1]

if type(selectedPhases) != list:
	selectedPhases = [selectedPhases]
if type(selectedDepartments) != list:
	selectedDepartments = [selectedDepartments]
	
rooms = FilteredElementCollector(doc).OfCategory(BuiltInCategory.OST_Rooms).WhereElementIsNotElementType().ToElements()

filteredLevels = []
for room in rooms:
	if room.Area > 0:
		phaseMatched = False
		deptMatched = False
		for phase in selectedPhases:
			if room.get_Parameter(BuiltInParameter.ROOM_PHASE).AsValueString() == phase:
				phaseMatched = True
				break
		for dept in selectedDepartments:
			if normalizeDepartmentName(room.LookupParameter("Department").AsString()) == dept:
				deptMatched = True
				break
			if dept == "unnamed" and room.LookupParameter("Department").AsString() == None:
				deptMatched = True
				break
		if phaseMatched and deptMatched:
			filteredLevels.append(room.Level)

levelNames = []
for level in filteredLevels:
	levelNames.append(level.Name)
uniqueLevelNames = uniqueVals(levelNames)

levelCounts = []
for levelName in uniqueLevelNames:
	levelCounter = 0
	for level in filteredLevels:
		if level.Name == levelName:
			levelCounter += 1
	levelCounts.append(levelCounter)

OUT = [uniqueLevelNames,levelCounts]
# ----------------------------------------
code_block_13 = CodeBlock(OUT=finding_room_levels_with_phase) { levelNames = OUT[0]; levelCounts = OUT[1]; }

# group: Bar Chart of Level Room Counts
code_block_14 = CodeBlock { chartName = "level distribution of rooms"; seriesName = "rooms"; xAxisTitle = "levels"; yAxisTitle = "count of rooms"; }
code_block_15 = CodeBlock { 254; 195; 41; }
byARGB_3 = Color.ByARGB(r=code_block_15.out0, g=code_block_15.out1, b=code_block_15.out2)
barChart_3 = Custom[UI.BarChart](Chart_name=code_block_14.chartName, Series_names=code_block_14.seriesName, X_values=code_block_13.levelNames, Y_values=code_block_13.levelCounts, Chart_colors_optionnal=byARGB_3, X_Axis_Label_optionnal=code_block_14.xAxisTitle, Y_Axis_Label_optionnal=code_block_14.yAxisTitle)

# group: Level Selection
code_block_16 = CodeBlock { listViewName = "select levels"; listViewHeight = 400; alphabetical = false; }
ui_listview_data_3 = Custom[UI.Listview Data](InputName=code_block_16.listViewName, Keys=code_block_13.levelNames, Values=code_block_13.levelNames, Height_optionnal=code_block_16.listViewHeight, SortItems_optionnal=code_block_16.alphabetical)

# group: Level Filter Interface
code_block_17 = CodeBlock { description = "Level Selection"; buttonText = "Select Levels"; }
list_create_3 = List.Create(item0=barChart_3, item1=ui_listview_data_3)
code_block_18 = CodeBlock { cancelButton = "STOP"; maxHeight = 1000; interfaceWidth = 600; }
ui_multipleinputform_3 = Custom[UI.MultipleInputForm ++](Description_optional=code_block_17.description, Logo_optional=file_path, ButtonText_optional=code_block_17.buttonText, Inputs=list_create_3, Toggle=ui_multipleinputform_2.Was_Run, CancelButtonText_optional=code_block_18.cancelButton, MaxHeight_optional=code_block_18.maxHeight, Width_optional=code_block_18.interfaceWidth)
flatten_3 = List.Flatten(list=ui_multipleinputform_3.User_Inputs)

# group: Getting Room Data
aprox_division_distance_for = CodeBlock { aproxDivisionDistance = 2; }  # "Aprox Division Distance for Curvilinear Geometry"
building_room_dataset = Python(IN[0]=aprox_division_distance_for, IN[1]=flatten, IN[2]=flatten_2, IN[3]=flatten_3)
# ---------- building_room_dataset.python (199 lines) ----------
import math

# Enable Python support and load DesignScript library
import clr
clr.AddReference('ProtoGeometry')
from Autodesk.DesignScript.Geometry import *

clr.AddReference('RevitNodes')
import Revit
clr.ImportExtensions(Revit.Elements)

clr.ImportExtensions(Revit.GeometryConversion)

clr.AddReference('RevitServices')
import RevitServices
from RevitServices.Persistence import DocumentManager
from RevitServices.Transactions import TransactionManager
from System.Collections.Generic import *

clr.AddReference('RevitAPI')
import Autodesk
from Autodesk.Revit.DB import *

clr.AddReference('DSCoreNodes')
import DSCore
from DSCore.List import *

def uniqueVals(_listInput):
	_listOut = [_listInput[0]]
	for i,_item in enumerate(_listInput):
		if i > 0:
			unique = True
			for _comparison in _listOut:
				if _comparison == _item:
					unique = False
					break
			if unique:
				_listOut.append(_item)
	return _listOut

def getBoundaryCurves(_room):
	_curvesOut = []
	return _room.GetBoundarySegments(SpatialElementBoundaryOptions())

def normalizeDepartmentName(_name):
	if _name:
		newName = ''
		for letter in _name:
			if letter == ',':
				letter = ''
			if letter == '&':
				letter = 'and'
			newName += letter
		return newName
	else:
		return ''

doc = DocumentManager.Instance.CurrentDBDocument
uiapp = DocumentManager.Instance.CurrentUIApplication
app = uiapp.Application
uidoc = DocumentManager.Instance.CurrentUIApplication.ActiveUIDocument

aproxDivisionDistance = IN[0]
selectedPhases = IN[1]
selectedDepts = IN[2]
selectedLevels = IN[3]

if type(selectedPhases) != list:
	selectedPhases = [selectedPhases]
if type(selectedDepts) != list:
	selectedDepts = [selectedDepts]
if type(selectedLevels) != list:
	selectedLevels = [selectedLevels]
	
rooms = FilteredElementCollector(doc).OfCategory(BuiltInCategory.OST_Rooms).WhereElementIsNotElementType().ToElements()
reportingData = []
roomData = []

for i, room in enumerate(rooms):
	try:
		phaseMatched = False
		departmentMatched = False
		levelMatched = False
		isActiveDesignOption = False
		for phase in selectedPhases:
			if room.get_Parameter(BuiltInParameter.ROOM_PHASE).AsValueString() == phase:
				phaseMatched = True
		for dept in selectedDepts:
			if normalizeDepartmentName(room.LookupParameter('Department').AsString()) == dept:
				departmentMatched = True
			if room.LookupParameter('Department').AsString() == None and dept == "unnamed":
				departmentMatched = True
		for level in selectedLevels:
			if room.Level.Name == level:
				levelMatched = True
		if not room.DesignOption:
			isActiveDesignOption = True
		elif room.DesignOption.IsPrimary():
			isActiveDesignOption = True

		if room.Area > 0 and phaseMatched and departmentMatched and levelMatched and isActiveDesignOption: 
			roomObject = {}
			roomObject["elevation"] = round(room.Level.Elevation)
			roomObject["level"] = room.Level.Name
			roomObject["area"] = room.Area
			
			########Additional parameters can be added to the list below as necessary
			roomObject["name"] = room.LookupParameter('Name').AsString()
			roomObject["department"] = room.LookupParameter('Department').AsString()
			if roomObject["department"] == '' or roomObject["department"] == None:
				roomObject["department"] = roomObject["name"]
			roomObject["phase"] = room.get_Parameter(BuiltInParameter.ROOM_PHASE).AsValueString()
			
			roomObject["number"] = room.LookupParameter('Number').AsString()
			roomObject["occupancy"] = room.LookupParameter('Occupancy').AsString()
			roomObject["base finish"] = room.LookupParameter('Base Finish').AsString()
			roomObject["ceiling finish"] = room.LookupParameter('Ceiling Finish').AsString()
			roomObject["wall finish"] = room.LookupParameter('Wall Finish').AsString()
			roomObject["floor finish"] = room.LookupParameter('Floor Finish').AsString()
			
			roomObject["unique id"] = room.UniqueId
			###########################################################################
			#########This section is for custom project parameters####################
			###########################################################################
			try:
				roomObject["teaching stations"] = room.LookupParameter('Teaching Station').AsDouble()
			except:
				"this parameter didn't exist"
				
			try:
				roomObject["client room number"] = room.LookupParameter('Client Room Number').AsString()
			except:
				"this parameter didn't exist"
				
			try:
				roomObject["room has window"] = room.LookupParameter('Room has Window').AsValueString()
			except:
				"this parameter didn't exist"
			###########################################################################
			###########################################################################
			###########################################################################
			roomObject["outerLoop"] = []
			roomObject["innerLoops"] = []
			boundaryCurves = getBoundaryCurves(room)
			
			reportingRoom = []
			##############The following for loop is the logic to convert the boundary curves into nested lists of points
			for j, loop in enumerate(boundaryCurves):
				if j == 0:
					accessKey = "outerLoop"
					roomObject[accessKey] = []
				else:
					accessKey = "innerLoops"
					accessIndex = j-1
					roomObject[accessKey].append([])
					
				reportingLoop = []
				for curve in loop:
					curveGeom = curve.GetCurve()
					reportingLoop.append(curveGeom.ToProtoType())
					type = curveGeom.GetType().ToString()
					
					if type == "Autodesk.Revit.DB.Line":
						pointDict = dict()
						startPoint = curveGeom.GetEndPoint(0)
						pointDict["x"] = round(startPoint.X,5)
						pointDict["y"] = round(startPoint.Y,5)
						pointDict["z"] = roomObject["elevation"]
						if j == 0:
							roomObject[accessKey].append(dict(pointDict))
						else:
							roomObject[accessKey][accessIndex].append(dict(pointDict))
					else:
						#the logic to run if the line is curved to generate approximating straight segment geometry				
						evalParams = []
						numberOfSteps = math.ceil(curveGeom.Length/aproxDivisionDistance)
						paramStep = 1/numberOfSteps
						for step in range(int(numberOfSteps)):
							evalParams.append((step)*paramStep)
							
						for param in evalParams:
							pointDict = dict()
							evalPoint = curveGeom.Evaluate(param,True)
							pointDict["x"] = round(evalPoint.X,5)
							pointDict["y"] = round(evalPoint.Y,5)
							pointDict["z"] = roomObject["elevation"]
							if j == 0:
								roomObject[accessKey].append(dict(pointDict))
							else:
								roomObject[accessKey][accessIndex].append(dict(pointDict))
				reportingRoom.append(reportingLoop)
			reportingData.append(reportingRoom)
				
			roomData.append(roomObject)
	except:
		'could not export room'	
				

OUT = [roomData,reportingData]
# ----------------------------------------

# group: Set Export Directory
code_block_19 = CodeBlock()
# ---------- code_block_19.designscript (4 lines) ----------
description = "select output directory";
buttonText = "copy path from file explorer";
testDefault = "//cga/Data/General/Dept/BIM/Dynamo/Mining Program Data/Data";
isNumberEntry = false;
# ----------------------------------------
ui_textbox_data = Custom[UI.TextBox Data](InputName=code_block_19.description, DefaultText=code_block_19.buttonText, IsNumberEntry=code_block_19.isNumberEntry)  # package Data-Shapes; Create Data for TextBox input in UI.MultipleInputForm ++ . Check out www.data-shapes.net for more informations

# group: Set Export Name
code_block_20 = CodeBlock()
# ---------- code_block_20.designscript (3 lines) ----------
description = "enter project export name (please avoid special characters)";
defaultText = "room data export";
isNumberEntry = false;
# ----------------------------------------
ui_textbox_data_2 = Custom[UI.TextBox Data](InputName=code_block_20.description, DefaultText=code_block_20.defaultText, IsNumberEntry=code_block_20.isNumberEntry)

# group: Select Metadata Model
# note: New Metadata models can be added, but logic should also be added to the python script to accomodate the additions.  This script does not generate the metadata, it only makes entries in the json export to accomodate this data.
meta_data_key = CodeBlock { description = "select meta data model"; metaDataModels = ["Education K-12", "Workplace", "Hospital", "Worship"]; }
ui_dropdown_data = Custom[UI.DropDown Data](InputName=meta_data_key.description, Keys=meta_data_key.metaDataModels, Values=meta_data_key.metaDataModels)  # package Data-Shapes; Create data for DropDown input in UI.MultiInputForm ++ . Check out www.data-shapes.net for more infos.

# group: Data Export Interface
code_block_21 = CodeBlock { "Set Export Parameters"; "Finish Export"; }
list_create_4 = List.Create(item0=ui_textbox_data, item1=ui_textbox_data_2, item2=ui_dropdown_data)
code_block_22 = CodeBlock { cancelButton = "STOP"; maxHeight = 1000; interfaceWidth = 1000; }
ui_multipleinputform_4 = Custom[UI.MultipleInputForm ++](Description_optional=code_block_21.out0, Logo_optional=file_path, ButtonText_optional=code_block_21.out1, Inputs=list_create_4, Toggle=ui_multipleinputform_3.Was_Run, CancelButtonText_optional=code_block_22.cancelButton, MaxHeight_optional=code_block_22.maxHeight)

# group: Education K-12 Metadata
# note: First line should be identical to metat data key from data shapes
education_metadata = CodeBlock { "Education K-12"; "Student Count"; "Maximum Student Capacity"; "Minimum Grade Level"; "Maximum Grade Level"; }
list_create_5 = List.Create(item0=education_metadata.out0, item1=education_metadata.out1, item2=education_metadata.out2, item3=education_metadata.out3, item4=education_metadata.out4)

# group: Workplace Metadata (placeholder)
# note: First line should be identical to metat data key from data shapes
hospital_metadata = CodeBlock { "Workplace"; "Branch"; "Employee Count"; "Campus"; }
list_create_6 = List.Create(item0=hospital_metadata.out0, item1=hospital_metadata.out1, item2=hospital_metadata.out2, item3=hospital_metadata.out3)

# group: Hospital Metadata (placeholder)
# note: First line should be identical to metat data key from data shapes
hospital_metadata_2 = CodeBlock { "Hospital"; "Bed Count"; "Nurse Count"; }
list_create_7 = List.Create(item0=hospital_metadata_2.out0, item1=hospital_metadata_2.out1, item2=hospital_metadata_2.out2)

# group: Worship Metadata (placeholder)
# note: First line should be identical to metat data key from data shapes
worship_metadata = CodeBlock { "Worship"; "Congregation Count"; "Sanctuary Capacity"; "Number of Staff Members"; }
list_create_8 = List.Create(item0=worship_metadata.out0, item1=worship_metadata.out1, item2=worship_metadata.out2, item3=worship_metadata.out3)

# group: Collecting Data for Run Log
code_block_23 = CodeBlock(phases=code_block.allPhases, phaseCounts=code_block.countOfRoomsPerPhase, selPhases=flatten, depts=code_block_7.departmentNames, deptCounts=code_block_7.departmentCounts, selDepts=flatten_2, levels=code_block_13.levelNames, levelCounts=code_block_13.levelCounts, selLevels=flatten_3)
# ---------- code_block_23.designscript (3 lines) ----------
phaseData = [phases,phaseCounts,selPhases];
deptData = [depts,deptCounts,selDepts];
levelData = [levels,levelCounts, selLevels];
# ----------------------------------------

# group: Exporting Final Results
list_create_9 = List.Create(item0=list_create_5, item1=list_create_6, item2=list_create_7, item3=list_create_8)
python_script = Python(IN[0]=building_room_dataset, IN[1]=ui_multipleinputform_4.User_Inputs, IN[2]=list_create_9, IN[3]=code_block_23.phaseData, IN[4]=code_block_23.deptData, IN[5]=code_block_23.levelData)
# ---------- python_script.python (188 lines) ----------
import os
import json
import csv
from collections import OrderedDict

def uniqueVals(_listInput):
	_listOut = [_listInput[0]]
	for i,_item in enumerate(_listInput):
		if i > 0:
			unique = True
			for _comparison in _listOut:
				if _comparison == _item:
					unique = False
					break
			if unique:
				_listOut.append(_item)
	return _listOut
	
def normalizeNulls(_input):
	if _input == "null" or _input == "" or _input == None:
		return ''
	else:
		return _input

def writeDictToCsv(_dataOut,_filePathOut):
    csv_headers = _dataOut[0].keys()
    #The data out should be formated as a list of dictionaries
    #each dictionary should have identical keys
    with open(_filePathOut, "w") as csvFile:
        writer = csv.DictWriter(csvFile, fieldnames = csv_headers, delimiter = ',', lineterminator = '\n')
        writer.writeheader()
        for row in _dataOut:
            writer.writerow(row)

directoryPath = IN[1][0]
normalizedPath = os.path.normpath(directoryPath)
exportName = IN[1][1]

csvExportName = exportName + ".csv"
jsonExportName = exportName + ".json"
logExportName = exportName + "_log.json"

csvExportPath = os.path.join(normalizedPath, csvExportName)
jsonExportPath = os.path.join(normalizedPath, jsonExportName)
logExportPath = os.path.join(normalizedPath, logExportName)

metaDataKey = IN[1][2]

metaData = IN[2]
roomData = IN[0][0]

metaDataMatched = False
for metaDataSet in metaData:
	if metaDataSet[0] == metaDataKey:
		metaDataTitle = metaDataSet.pop(0)
		metaDataKeys = metaDataSet
		metaDataMatched = True
if not metaDataMatched:
	metaDataKeys = ["manually enter metadata here"]


### fixing an issue with the point dictionaries not being JSON serializable
for room in roomData:
	newOuterLoop = []
	for point in room["outerLoop"]:
		pointDict = dict(point)
		newOuterLoop.append(pointDict)
	room["outerLoop"] = newOuterLoop
	
	newInnerLoops = []
	if len(room["innerLoops"]) > 0:
		for loop in room["innerLoops"]:
			newInnerLoop = []
			for point in loop:
				pointDict = dict(point)
				newInnerLoop.append(pointDict)
			newInnerLoops.append(newInnerLoop)
		room["innerLoops"] = newInnerLoops
		
	else:
		room["innerLoops"] = False
		
metaDataTitle += " Metadata"
metaDataObj = {}
for key in metaDataKeys:
	metaDataObj[key] = None

dataObjectToJson = {metaDataTitle:dict(metaDataObj), "Room Data":roomData, "Analysis Name": exportName}
with open(jsonExportPath, 'w') as jsonOutFile:
	json.dump(dataObjectToJson, jsonOutFile, indent = 2)
	
csvListOfObjects = []
for room in roomData:
	rowObject = OrderedDict()
	rowObject["room number"] = normalizeNulls(room["number"])
	
	try:
		rowObject["client room number"] = normalizeNulls(room["client room number"])
	except:
		"parameter didn't exist"
		
	rowObject["room name"] = normalizeNulls(room["name"])
	rowObject["department"] = normalizeNulls(room["department"])
	rowObject["level"] = normalizeNulls(room["level"])
	rowObject["elevation"] = normalizeNulls(room["elevation"])
	rowObject["area"] = normalizeNulls(room["area"])
	
	try:
		rowObject["teaching stations"] = normalizeNulls(room["teaching stations"])
	except:
		"parameter didn't exist"
	
	try:
		rowObject["has window"] = normalizeNulls(room["room has window"])
	except:
		"parameter didn't exist"	
	
	rowObject["wall finish"] = normalizeNulls(room["wall finish"])
	rowObject["ceiling finish"] = normalizeNulls(room["ceiling finish"])
	rowObject["base finish"] = normalizeNulls(room["base finish"])
	rowObject["floor finish"] = normalizeNulls(room["floor finish"])
	rowObject["phase"] = normalizeNulls(room["phase"])
	rowObject["unique id"] = normalizeNulls(room["unique id"])

	
	csvListOfObjects.append(rowObject)

writeDictToCsv(csvListOfObjects,csvExportPath)


phaseData = IN[3]
departmentData = IN[4]
levelData = IN[5]

phaseIncluded = 0
phaseExcluded = 0
for i,phase in enumerate(phaseData[0]):
	matched = False
	for selPhase in phaseData[2]:
		if selPhase == phase:
			matched = True
			break
	if matched:
		phaseIncluded += phaseData[1][i]
	else:
		phaseExcluded += phaseData[1][i]
		
deptsIncluded = 0
deptsExcluded = 0
for i,dept in enumerate(departmentData[0]):
	matched = False
	for selDept in departmentData[2]:
		if selDept == dept:
			matched = True
			break
	if matched:
		deptsIncluded += departmentData[1][i]
	else:
		deptsExcluded += departmentData[1][i]
		
levelsIncluded = 0
levelsExcluded = 0
for i,lvl in enumerate(levelData[0]):
	matched = False
	for selLvl in levelData[2]:
		if selLvl == lvl:
			matched = True
			break
	if matched:
		levelsIncluded += levelData[1][i]
	else:
		levelsExcluded += levelData[1][i]

logData = {
	"FIRST_selected_phases": phaseData[2],
	"phase_included_room_count": int(phaseIncluded),
	"phase_excluded_room_count": int(phaseExcluded),
	"SECOND_selected_departments": departmentData[2],
	"department_included_room_count": int(deptsIncluded),
	"department_excluded_room_count": int(deptsExcluded),
	"THIRD_selected_levels": levelData[2],
	"levels_included_room_count": int(levelsIncluded),
	"levels_excluded_room_count": int(levelsExcluded)
}


with open(logExportPath, 'w') as jsonOutFile:
	json.dump(logData, jsonOutFile, indent = 2)
# ----------------------------------------

# group: Observing Results of Room Data Collection
code_block_24 = CodeBlock(OUT=building_room_dataset) { roomData = OUT[0]; reportingData = OUT[1]; }
watch = Watch(code_block_24.reportingData)
watch_2 = Watch(code_block_24.roomData)

watch_3 = Watch(code_block_23.levelData)
