# Dynamo graph Mining Program Data_backup.dyn (Dynamo 2.3.0.5885)
# packages: Data-Shapes 2019.2.42

getting_room_data = Python()  # frozen; unwired: IN[0], IN[1]
# ---------- getting_room_data.python (114 lines) ----------
# Enable Python support and load DesignScript library
import clr
clr.AddReference('ProtoGeometry')
from Autodesk.DesignScript.Geometry import *

clr.AddReference('RevitNodes')
import Revit
clr.ImportExtensions(Revit.Elements)

clr.ImportExtensions(Revit.GeometryConversion)

clr.AddReference('RevitServices')
import RevitServices
from RevitServices.Persistence import DocumentManager
from RevitServices.Transactions import TransactionManager
from System.Collections.Generic import *

clr.AddReference('RevitAPI')
import Autodesk
from Autodesk.Revit.DB import *

clr.AddReference('DSCoreNodes')
import DSCore
from DSCore.List import *

def uniqueVals(_listInput):
	_listOut = [_listInput[0]]
	for i,_item in enumerate(_listInput):
		if i > 0:
			unique = True
			for _comparison in _listOut:
				if _comparison == _item:
					unique = False
					break
			if unique:
				_listOut.append(_item)
	return _listOut


doc = DocumentManager.Instance.CurrentDBDocument
uiapp = DocumentManager.Instance.CurrentUIApplication
app = uiapp.Application
uidoc = DocumentManager.Instance.CurrentUIApplication.ActiveUIDocument

links = FilteredElementCollector(doc).OfClass(RevitLinkInstance)

linkTarget = IN[1][0]

projectLevels = FilteredElementCollector(doc).OfClass(Level)
projectLevelElevations = []

for level in projectLevels:
	projectLevelElevations.append(round(level.Elevation))

roomsOut = []
roomNames = []
roomDepartments = []
roomNumbers = []
roomAreas = []
roomPhases = []
associatedLevelElevations = []
createLevelsAtElevations = []

for i in links:
	try:
		linkName = i.Name.split(':')[0]
		if linkName == linkTarget:
			doclink = i.GetLinkDocument()
			
			rooms = FilteredElementCollector(doclink).OfCategory(BuiltInCategory.OST_Rooms).WhereElementIsNotElementType().ToElements()
			
			for room in rooms:
				roomsOut.append(room)
				roomNames.append(room.LookupParameter('Name').AsString())
				#roomPhases.append(room.GetPhaseStatus())
				roomNumbers.append(room.LookupParameter('Number').AsString())
				roomDepartments.append(room.LookupParameter('Department').AsString())
				roomAreas.append(room.Area)
				roomLevelElevation = round(room.Level.Elevation)
				associatedLevelElevations.append(roomLevelElevation)
				
				levelUnmatched = True
				for i,projectLevelElevation in enumerate(projectLevelElevations):
					if roomLevelElevation == projectLevelElevation:
						levelUnmatched = False
						break
				if levelUnmatched:
					createLevelsAtElevations.append(roomLevelElevation)
			
		
		#out.append(plnBlocks)
	except:
		print("failed")

if createLevelsAtElevations:
	createLevelsAtElevations = uniqueVals(createLevelsAtElevations)
	
TransactionManager.Instance.EnsureInTransaction(doc)

for elevation in createLevelsAtElevations:
	Level.Create(doc,elevation)

TransactionManager.Instance.TransactionTaskDone()

dataOut = [roomsOut,roomNames,roomNumbers,roomDepartments,roomAreas,associatedLevelElevations]

for i,list in enumerate(dataOut):
	if i > 0:
		for j,data in enumerate(list):
			if not data or data == '':
				dataOut[i][j] = " "

OUT = dataOut
#OUT = projectLevelElevations
# ----------------------------------------

# group: Filtering Room Data
filter_by_departments_and_phases = Python(IN[0]=getting_room_data)  # unwired: IN[1], IN[2]
# ---------- filter_by_departments_and_phases.python (67 lines) ----------
# Enable Python support and load DesignScript library
import clr
clr.AddReference('ProtoGeometry')
from Autodesk.DesignScript.Geometry import *

clr.AddReference('RevitNodes')
import Revit
clr.ImportExtensions(Revit.Elements)

clr.ImportExtensions(Revit.GeometryConversion)

clr.AddReference('RevitServices')
import RevitServices
from RevitServices.Persistence import DocumentManager
from RevitServices.Transactions import TransactionManager
from System.Collections.Generic import *

clr.AddReference('RevitAPI')
import Autodesk
from Autodesk.Revit.DB import *

clr.AddReference('DSCoreNodes')
import DSCore
from DSCore.List import *


allRoomData = IN[0]
roomsIndex = 0
departmentsToExclude = IN[1]
phasesToSelect = IN[2]

roomDataOut = []
includeIndices = []

for i,dept in enumerate(allRoomData[3]):
	include = True
	for excludeDept in departmentsToExclude:
		if dept == excludeDept:
			include = False
	room = UnwrapElement(allRoomData[roomsIndex][i])
	roomPhase = room.get_Parameter(BuiltInParameter.ROOM_PHASE).AsValueString()
	
	phaseMatched = False
	for phase in phasesToSelect:
		if roomPhase == phase:
			phaseMatched = True
			
	if phaseMatched != True:
		include = False
	
	if include:
		includeIndices.append(i)

for i,category in enumerate(allRoomData):
	if i < 7:
		roomDataOut.append([])

for i,category in enumerate(allRoomData):
	if i < 7:
		for j,roomData in enumerate(category):
			for index in includeIndices:
				if j == index:
					roomDataOut[i].append(roomData)

OUT = roomDataOut

#ROOM_PHASE
# ----------------------------------------
filtering_invalid_rooms = Python(IN[0]=filter_by_departments_and_phases)
# ---------- filtering_invalid_rooms.python (108 lines) ----------
################# USER INPUTS #################
roomIndex = 0
elevationIndex = 5
###############################################

# Enable Python support and load DesignScript library
import clr
clr.AddReference('ProtoGeometry')
from Autodesk.DesignScript.Geometry import *

clr.AddReference('RevitNodes')
import Revit
clr.ImportExtensions(Revit.Elements)

clr.ImportExtensions(Revit.GeometryConversion)

clr.AddReference('RevitServices')
import RevitServices
from RevitServices.Persistence import DocumentManager
from RevitServices.Transactions import TransactionManager
from System.Collections.Generic import *

clr.AddReference('RevitAPI')
import Autodesk
from Autodesk.Revit.DB import *

clr.AddReference('DSCoreNodes')
import DSCore
from DSCore.List import *

def uniqueVals(_listInput):
	_listOut = [_listInput[0]]
	for i,_item in enumerate(_listInput):
		if i > 0:
			unique = True
			for _comparison in _listOut:
				if _comparison == _item:
					unique = False
					break
			if unique:
				_listOut.append(_item)
	return _listOut


doc = DocumentManager.Instance.CurrentDBDocument
uiapp = DocumentManager.Instance.CurrentUIApplication
app = uiapp.Application
uidoc = DocumentManager.Instance.CurrentUIApplication.ActiveUIDocument


roomsIn = []
roomDataIn = []
elevationData = []
invalidGeomCounter = 0
zeroAreaRoomCounter = 0
filteredIndices = []

filteredRoomData = []

roomGeometryOut = []

for i,data in enumerate(IN[0]):
	if i == roomIndex:
		roomsIn = data
	else:
		roomDataIn.append(data)
	if i == elevationIndex:
		elevationData = data

for i,room in enumerate(roomsIn):
	if room.Area and room.Area > 1:
		try:
			room = UnwrapElement(room)
			elevation = elevationData[i]
			roomGeometry = room.GetGeometryObjectFromReference(Reference(room))
			geomObj = roomGeometry.GetEnumerator()
			
			for geom in geomObj:
				roomGeom = geom.ToProtoType()
				
			if roomGeom and roomGeom != '':
				roomGeometryOut.append(roomGeom)
				filteredIndices.append(i)
			else:
				invalidGeomCounter += 1
			
		except:
			
			invalidGeomCounter += 1
			#outTest.append(i)
	else:
		zeroAreaRoomCounter += 1


warningStatement = [str(zeroAreaRoomCounter) + " room(s) were identified which had an area of essentially 0.  ", str(invalidGeomCounter) + " ROOM(S) COULD NOT BE CONVERTED TO USABLE GEOMETRY."]

for i,data in enumerate(roomDataIn):
	filteredRoomData.append([])

for i,data in enumerate(roomDataIn):
	for j,item in enumerate(data):
		if j in filteredIndices:
			filteredRoomData[i].append(item)




OUT = [roomGeometryOut,warningStatement,filteredRoomData]
# ----------------------------------------
code_block = CodeBlock(OUT=filtering_invalid_rooms)
# ---------- code_block.designscript (7 lines) ----------
roomGeometry = OUT[0];
warningStatement = OUT[1];
roomNames = OUT[2][0];
roomNumbers = OUT[2][1];
roomDepartments = OUT[2][2];
roomAreas = OUT[2][3];
roomElevations = OUT[2][4];
# ----------------------------------------

majorAxis = Ellipse.MajorAxis()  # unwired: ellipse
code_block_2 = CodeBlock { aproxDivisionDistance = 2; }

# group: Getting Phases
getting_phases = Python()
# ---------- getting_phases.python (67 lines) ----------
# Enable Python support and load DesignScript library
import clr
clr.AddReference('ProtoGeometry')
from Autodesk.DesignScript.Geometry import *

clr.AddReference('RevitNodes')
import Revit
clr.ImportExtensions(Revit.Elements)

clr.ImportExtensions(Revit.GeometryConversion)

clr.AddReference('RevitServices')
import RevitServices
from RevitServices.Persistence import DocumentManager
from RevitServices.Transactions import TransactionManager
from System.Collections.Generic import *

clr.AddReference('RevitAPI')
import Autodesk
from Autodesk.Revit.DB import *

clr.AddReference('DSCoreNodes')
import DSCore
from DSCore.List import *

def uniqueVals(_listInput):
	_listOut = [_listInput[0]]
	for i,_item in enumerate(_listInput):
		if i > 0:
			unique = True
			for _comparison in _listOut:
				if _comparison == _item:
					unique = False
					break
			if unique:
				_listOut.append(_item)
	return _listOut


doc = DocumentManager.Instance.CurrentDBDocument
uiapp = DocumentManager.Instance.CurrentUIApplication
app = uiapp.Application
uidoc = DocumentManager.Instance.CurrentUIApplication.ActiveUIDocument

phaseNames = []
phaseIds = []
for phase in doc.Phases:
	phaseNames.append(phase.Name)
	phaseIds.append(phase.Id)

rooms = FilteredElementCollector(doc).OfCategory(BuiltInCategory.OST_Rooms).WhereElementIsNotElementType().ToElements()

roomsInPhase = []
roomPhases = []
for room in rooms:
	roomPhases.append(room.get_Parameter(BuiltInParameter.ROOM_PHASE).AsValueString())

for phase in phaseNames:
	roomCounter = 0
	for roomPhase in roomPhases:
		if phase == roomPhase:
			roomCounter += 1
	roomsInPhase.append(roomCounter)
		


OUT = [phaseNames,roomsInPhase]
# ----------------------------------------
code_block_3 = CodeBlock(OUT=getting_phases) { allPhases = OUT[0]; countOfRoomsPerPhase = OUT[1]; }

code_block_4 = CodeBlock(phases=code_block_3.allPhases) { LogicToGetPhaseName = phases[1]; }
python_script = Python(IN[0]=code_block_2, IN[1]=code_block_4)
# ---------- python_script.python (118 lines) ----------
import math

# Enable Python support and load DesignScript library
import clr
clr.AddReference('ProtoGeometry')
from Autodesk.DesignScript.Geometry import *

clr.AddReference('RevitNodes')
import Revit
clr.ImportExtensions(Revit.Elements)

clr.ImportExtensions(Revit.GeometryConversion)

clr.AddReference('RevitServices')
import RevitServices
from RevitServices.Persistence import DocumentManager
from RevitServices.Transactions import TransactionManager
from System.Collections.Generic import *

clr.AddReference('RevitAPI')
import Autodesk
from Autodesk.Revit.DB import *

clr.AddReference('DSCoreNodes')
import DSCore
from DSCore.List import *

def uniqueVals(_listInput):
	_listOut = [_listInput[0]]
	for i,_item in enumerate(_listInput):
		if i > 0:
			unique = True
			for _comparison in _listOut:
				if _comparison == _item:
					unique = False
					break
			if unique:
				_listOut.append(_item)
	return _listOut

def getBoundaryCurves(_room):
	_curvesOut = []
	return _room.GetBoundarySegments(SpatialElementBoundaryOptions())


doc = DocumentManager.Instance.CurrentDBDocument
uiapp = DocumentManager.Instance.CurrentUIApplication
app = uiapp.Application
uidoc = DocumentManager.Instance.CurrentUIApplication.ActiveUIDocument

aproxDivisionDistance = IN[0]
selectedPhases = IN[1]

#projectLevels = FilteredElementCollector(doc).OfClass(Level)
#projectLevelElevations = []

#for level in projectLevels:
#	projectLevelElevations.append(round(level.Elevation))
	
rooms = FilteredElementCollector(doc).OfCategory(BuiltInCategory.OST_Rooms).WhereElementIsNotElementType().ToElements()

roomData = []
pointDict = {}
for i, room in enumerate(rooms):
	
	if room.Area > 0:
		roomData.append({})
		roomData[i]["elevation"] = round(room.Level.Elevation)
		roomData[i]["area"] = room.Area
		
		########Additional parameters can be added to the list below as necessary
		roomData[i]["name"] = room.LookupParameter('Name').AsString()
		roomData[i]["department"] = room.LookupParameter('Department').AsString()
		roomData[i]["number"] = room.LookupParameter('Number').AsString()
		roomData[i]["occupancy"] = room.LookupParameter('Occupancy').AsString()
		roomData[i]["base finish"] = room.LookupParameter('Base Finish').AsString()
		roomData[i]["ceiling finish"] = room.LookupParameter('Ceiling Finish').AsString()
		roomData[i]["wall finish"] = room.LookupParameter('Wall Finish').AsString()
		roomData[i]["floor finish"] = room.LookupParameter('Floor Finish').AsString()
		
		roomData[i]["loopData"] = []
		boundaryCurves = getBoundaryCurves(room)
		
		##############The following for loop is the logic to convert the boundary curves into nested lists of points
		for j, loop in enumerate(boundaryCurves):
			roomData[i]["loopData"].append({"points":[],"outerLoop":False})
			
			if j == 0:
				roomData[i]["loopData"][j]["outerLoop"]=True
			
			for curve in loop:
				curveGeom = curve.GetCurve()
				type = curveGeom.GetType().ToString()
				
				if type == "Autodesk.Revit.DB.Line":
					startPoint = curveGeom.GetEndPoint(0)
					pointDict["x"] = startPoint.X
					pointDict["y"] = startPoint.Y
					pointDict["z"] = roomData[i]["elevation"]
					roomData[i]["loopData"][j]["points"].append(pointDict)
				else:
					#the logic to run if the line is curved to generate approximating straight segment geometry				
					evalParams = []
					numberOfSteps = math.ceil(curveGeom.Length/aproxDivisionDistance)
					paramStep = 1/numberOfSteps
					for step in range(int(numberOfSteps)):
						evalParams.append((step)*paramStep)
						
					for param in evalParams:
						evalPoint = curveGeom.Evaluate(param,True)
						pointDict["x"] = evalPoint.X
						pointDict["y"] = evalPoint.Y
						pointDict["z"] = roomData[i]["elevation"]
						roomData[i]["loopData"][j]["points"].append(pointDict)
					
				

OUT = roomData
# ----------------------------------------
watch = Watch(python_script)

# group: Logo File Path
file_path = Filename("..\..\..\..\KnowledgeMgmt\ReCouncil\00_Templates and Processes\CGA Assets\CGA Logo Image.jpg")

# group: Bar Chart of Phases Room Counts
code_block_5 = CodeBlock { chartName = "phase distribution of rooms"; seriesName = "rooms"; xAxisTitle = "phases"; yAxisTitle = "count of rooms"; }
code_block_6 = CodeBlock { 254; 195; 41; }
byARGB = Color.ByARGB(r=code_block_6.out0, g=code_block_6.out1, b=code_block_6.out2)
barChart = Custom[UI.BarChart](Chart_name=code_block_5.chartName, Series_names=code_block_5.seriesName, X_values=code_block_3.allPhases, Y_values=code_block_3.countOfRoomsPerPhase, Chart_colors_optionnal=byARGB, X_Axis_Label_optionnal=code_block_5.xAxisTitle, Y_Axis_Label_optionnal=code_block_5.yAxisTitle)  # package Data-Shapes; BarChart

# group: Phase Selection
code_block_7 = CodeBlock { listViewName = "select phases"; listViewHeight = 300; }
ui_listview_data = Custom[UI.Listview Data](InputName=code_block_7.listViewName, Keys=code_block_3.allPhases, Values=code_block_3.allPhases, Height_optionnal=code_block_7.listViewHeight)  # package Data-Shapes; Create data for ListView input in UI.MultiInputForm ++ . Check out www.data-shapes.net for more infos.

# group: Phase Filter Interface
code_block_8 = CodeBlock { description = "Phase Selection"; buttonText = "Select Phases"; }
list_create = List.Create(item0=barChart, item1=ui_listview_data)
boolean = BoolSelector(true)
code_block_9 = CodeBlock { cancelButton = "STOP"; maxHeight = 1000; interfaceWidth = 600; }
ui_multipleinputform = Custom[UI.MultipleInputForm ++](Description_optional=code_block_8.description, Logo_optional=file_path, ButtonText_optional=code_block_8.buttonText, Inputs=list_create, Toggle=boolean, CancelButtonText_optional=code_block_9.cancelButton, MaxHeight_optional=code_block_9.maxHeight, Width_optional=code_block_9.interfaceWidth)  # package Data-Shapes; Create a form with multiple inputs. see www.data-shapes.net for tutorials and infos!
flatten = List.Flatten(list=ui_multipleinputform.User_Inputs)

# group: Filtering By Phase and Getting Depts
filtering_rooms_by_phases_and = Python(IN[0]=flatten)  # "Filtering Rooms by Phases and Finding Levels"
# ---------- filtering_rooms_by_phases_and.python (68 lines) ----------
# Enable Python support and load DesignScript library
import clr
clr.AddReference('ProtoGeometry')
from Autodesk.DesignScript.Geometry import *

clr.AddReference('RevitNodes')
import Revit
clr.ImportExtensions(Revit.Elements)

clr.ImportExtensions(Revit.GeometryConversion)

clr.AddReference('RevitServices')
import RevitServices
from RevitServices.Persistence import DocumentManager
from RevitServices.Transactions import TransactionManager
from System.Collections.Generic import *

clr.AddReference('RevitAPI')
import Autodesk
from Autodesk.Revit.DB import *

clr.AddReference('DSCoreNodes')
import DSCore
from DSCore.List import *

def uniqueVals(_listInput):
	_listOut = [_listInput[0]]
	for i,_item in enumerate(_listInput):
		if i > 0:
			unique = True
			for _comparison in _listOut:
				if _comparison == _item:
					unique = False
					break
			if unique:
				_listOut.append(_item)
	return _listOut


doc = DocumentManager.Instance.CurrentDBDocument
uiapp = DocumentManager.Instance.CurrentUIApplication
app = uiapp.Application
uidoc = DocumentManager.Instance.CurrentUIApplication.ActiveUIDocument

selectedPhases = IN[0]

if type(selectedPhases) != list:
	selectedPhases = [selectedPhases]

rooms = FilteredElementCollector(doc).OfCategory(BuiltInCategory.OST_Rooms).WhereElementIsNotElementType().ToElements()

filteredDepartments = []
for room in rooms:
	for phase in selectedPhases:
		if room.get_Parameter(BuiltInParameter.ROOM_PHASE).AsValueString() == phase:
			filteredDepartments.append(room.LookupParameter("Department").AsString())

uniqueDepartments = uniqueVals(filteredDepartments)
departmentCounts = []

for uniqueDept in uniqueDepartments:
	deptCount = 0
	for dept in filteredDepartments:
		if uniqueDept == dept:
			deptCount += 1
	departmentCounts.append(deptCount)

OUT = [uniqueDepartments,departmentCounts]
# ----------------------------------------
code_block_10 = CodeBlock(OUT=filtering_rooms_by_phases_and) { departmentNames = OUT[0]; departmentCounts = OUT[1]; }

# group: Bar Chart of Dept Room Counts
code_block_11 = CodeBlock()
# ---------- code_block_11.designscript (4 lines) ----------
chartName = "department distribution of rooms";
seriesName = "rooms";
xAxisTitle = "departments";
yAxisTitle = "count of rooms";
# ----------------------------------------
code_block_12 = CodeBlock { 254; 195; 41; }
byARGB_2 = Color.ByARGB(r=code_block_12.out0, g=code_block_12.out1, b=code_block_12.out2)
barChart_2 = Custom[UI.BarChart](Chart_name=code_block_11.chartName, Series_names=code_block_11.seriesName, X_values=code_block_10.departmentNames, Y_values=code_block_10.departmentCounts, Chart_colors_optionnal=byARGB_2, X_Axis_Label_optionnal=code_block_11.xAxisTitle, Y_Axis_Label_optionnal=code_block_11.yAxisTitle)

# group: Department Selection
code_block_13 = CodeBlock { listViewName = "select departments"; listViewHeight = 300; }
ui_listview_data_2 = Custom[UI.Listview Data](InputName=code_block_13.listViewName, Keys=code_block_10.departmentNames, Values=code_block_10.departmentNames, Height_optionnal=code_block_13.listViewHeight)

# group: Department Filter Interface
code_block_14 = CodeBlock { description = "Department Selection"; buttonText = "Select Departments"; }
list_create_2 = List.Create(item0=barChart_2, item1=ui_listview_data_2)
code_block_15 = CodeBlock { cancelButton = "STOP"; maxHeight = 1000; interfaceWidth = 600; }
ui_multipleinputform_2 = Custom[UI.MultipleInputForm ++](Description_optional=code_block_14.description, Logo_optional=file_path, ButtonText_optional=code_block_14.buttonText, Inputs=list_create_2, Toggle=ui_multipleinputform.Was_Run, CancelButtonText_optional=code_block_15.cancelButton, MaxHeight_optional=code_block_15.maxHeight, Width_optional=code_block_15.interfaceWidth)
flatten_2 = List.Flatten(list=ui_multipleinputform_2.User_Inputs)
